# Dynamo graph Print_Current.dyn (Dynamo 2.10.1.3976)

current = Document.Current()
activeView = Document.ActiveView(document=current)
watch = Watch(activeView)

# group: check if a user in a view not in a Sheet --> get the Sheet
code_block = CodeBlock { "Sheets"; }
byName = Category.ByName(name=code_block)
all_elements_of_category = ElementsOfCategory(Category=byName)
string_from_object = FromObject(obj=all_elements_of_category)
code_block_2 = CodeBlock { "Sheet(Name = "; }
split = String.Split(str=string_from_object, separator0=code_block_2)
code_block_3 = CodeBlock { " )"; }
split_2 = String.Split(str=split, separator0=code_block_3)
code_block_4 = CodeBlock { "Sheet Name"; }
parameterByName = Parameter.ParameterByName(element=watch, name=code_block_4)
string_from_object_2 = FromObject(obj=parameterByName)
code_block_5 = CodeBlock { "Sheet Name : "; }
split_3 = String.Split(str=string_from_object_2, separator0=code_block_5)
flatten = List.Flatten(list=split_3)
contains = String.Contains(str=split_2, searchFor=flatten, lacing=Longest)
flatten_2 = List.Flatten(list=contains)
filterByBoolMask = List.FilterByBoolMask(list=all_elements_of_category, mask=flatten_2)
watch_2 = Watch(filterByBoolMask.in)

string_from_object_3 = FromObject(obj=activeView)
code_block_6 = CodeBlock { "Sheet"; }
contains_2 = String.Contains(str=string_from_object_3, searchFor=code_block_6)
if_ = If(test=contains_2, true=activeView, false=filterByBoolMask.in)
watch_3 = Watch(if_)

# group: get the selected sheets if any
select_model_elements = Python()  # IronPython2; unwired: IN[0]
# ---------- select_model_elements.python (27 lines) ----------
import clr
clr.AddReference('RevitNodes')
import Revit
clr.ImportExtensions(Revit.GeometryConversion)

clr.AddReference('RevitAPI')
import Autodesk
from Autodesk.Revit.DB import *

clr.AddReference("RevitServices")
import RevitServices
from RevitServices.Persistence import DocumentManager
doc = DocumentManager.Instance.CurrentDBDocument
uiapp = DocumentManager.Instance.CurrentUIApplication
uidoc = DocumentManager.Instance.CurrentUIApplication.ActiveUIDocument
app = uiapp.Application


ids = uidoc.Selection.GetElementIds()
elems = []
for id in ids:
	try:
		elems.append(doc.GetElement(id))
	except:
		elems.append('Element retrieval failed')

OUT = elems
# ----------------------------------------
getCategory = Element.GetCategory(element=select_model_elements)
input_check = Python(IN[0]=getCategory)  # IronPython2
# ---------- input_check.python (8 lines) ----------
input = IN[0]
elements = []

if isinstance(input, list): 
	for i in input:	elements.append(i)
else: elements = [input]
		
OUT = elements
# ----------------------------------------
code_block_7 = CodeBlock { "Sheets"; }
byName_2 = Category.ByName(name=code_block_7)
input_check_2 = Python(IN[0]=select_model_elements)  # IronPython2; same code as input_check
category_filter = Python(IN[0]=input_check, IN[1]=byName_2, IN[2]=input_check_2, IN[3]=select_model_elements)  # IronPython2
# ---------- category_filter.python (8 lines) ----------
outt = []

for i in range(len(IN[0])):
	if IN[0][i] ==IN[1]:
		outt.append(IN[2][i])
		
if IN[3] == []: OUT = None
else: OUT = outt
# ----------------------------------------
sorted = Python(IN[0]=category_filter)  # IronPython2
# ---------- sorted.python (16 lines) ----------
import clr
clr.AddReference('ProtoGeometry')
from Autodesk.DesignScript.Geometry import *
#The inputs to this node will be stored as a list in the IN variable.
inp = IN[0]
zz = []
for i in inp: zz.append(i.SheetNumber)

zipped = zip(zz,inp)

sorted_zipped_lists = sorted(zipped)

#crazy way to get the second element fom any sublist
sorted_list1 = [element for _, element in sorted_zipped_lists]

OUT = sorted_list1
# ----------------------------------------
watch_4 = Watch(sorted)  # graph output
watch_5 = Watch(select_model_elements)  # graph output

firstItem = List.FirstItem(list=if_)
python_script = Python(IN[0]=sorted, IN[1]=firstItem)  # IronPython2
# ---------- python_script.python (4 lines) ----------
if IN[0] == None:
	OUT = IN[1]
else: OUT = IN[0]
	
# ----------------------------------------
input_check_3 = Python(IN[0]=python_script)  # IronPython2; same code as input_check
current_2 = Document.Current()
filePath = Document.FilePath(document=current_2)
folder = Python(IN[0]=filePath)  # IronPython2
# ---------- folder.python (7 lines) ----------
x = IN[0].split('\\')

f = x[len(x)-1:]

m = f[0].split(".")

OUT = m[0]
# ----------------------------------------
current_date = Python(IN[0]=folder)  # IronPython2
# ---------- current_date.python (3 lines) ----------
from datetime import date
today = date.today()
OUT = IN[0] + ' ' +today.strftime("%d.%m.%y")
# ----------------------------------------
folder_2 = Python(IN[0]=filePath)  # IronPython2
# ---------- folder_2.python (10 lines) ----------
x = IN[0].split('\\')

line = []
y = x[:-1]
z = []
for i in y: 
	z.append(i+'\\')
line = (''.join(z))

OUT = line+'Export'
# ----------------------------------------
watch_6 = Watch(folder_2)
pdf_print = Python(IN[0]=input_check_3, IN[1]=current_date, IN[2]=watch_6)  # IronPython2
# ---------- pdf_print.python (38 lines) ----------
#Sean Page, 2021
import clr

clr.AddReference('RevitAPI')
from Autodesk.Revit.DB import *

clr.AddReference('System')
from System.Collections.Generic import List

clr.AddReference('RevitNodes')
import Revit
clr.ImportExtensions(Revit.Elements)

clr.AddReference('RevitServices')
import RevitServices
from RevitServices.Persistence import DocumentManager

doc = DocumentManager.Instance.CurrentDBDocument

Sheets = UnwrapElement(IN[0])
Names = IN[1]
Folder = IN[2]
result = []

opts = PDFExportOptions()
opts.Combine = True
opts.ColorDepth = ColorDepthType.Color
opts.ExportQuality = PDFExportQualityType.DPI600
opts.PaperFormat = ExportPaperFormat.Default #This will uses the Sheet Size for Paper size
opts.FileName = Names

sheetSet = List[ElementId]()
for i in Sheets:       
	sheetSet.Add(i.Id)

result.append(doc.Export(Folder,sheetSet,opts))

OUT = sheetSet
# ----------------------------------------
file_name = Python(IN[0]=watch_6, IN[1]=current_date)  # IronPython2
# ---------- file_name.python (1 lines) ----------
OUT = IN[0] + '\\' + IN[1] + ".pdf"
# ----------------------------------------
boolean = BoolSelector(true)
string = StringInput("C:\Program Files (x86)\Adobe\Acrobat DC\Acrobat\Acrobat.exe")
string_2 = StringInput("C:\Program Files\Bluebeam Software\Bluebeam Revu\Revu\Revu.exe")
file_open = Python(IN[0]=file_name, IN[1]=boolean, IN[2]=string, IN[3]=string_2)  # IronPython2
# ---------- file_open.python (32 lines) ----------
# Load the Python Standard and DesignScript Libraries
import sys
import clr
import os
import subprocess
#clr.AddReference('ProtoGeometry')
#from Autodesk.DesignScript.Geometry import *

# The inputs to this node will be stored as a list in the IN variables.
#dataEnteringNode = IN

# Place your code below this line


txt1 = IN[0]
#txt1 = 'C:\1.txt'
bool = IN[1]


#SPath = r'C:\Windows\System32\notepad.exe'


try:
	if bool:
		subprocess.Popen([IN[2], txt1])
except:
	if bool:
		subprocess.Popen([IN[3], txt1])

#subprocess.Popen('explorer "C:\temp"') #itWorks!
# Assign your output to the OUT variable.
#OUT = 0
# ----------------------------------------
