# Dynamo graph Print_Last_Rev.dyn (Dynamo 2.10.1.3976)

get_all_sheets = Python()  # IronPython2; unwired: IN[0]
# ---------- get_all_sheets.python (25 lines) ----------
import clr

clr.AddReference('RevitAPI')
from Autodesk.Revit.DB import *
clr.AddReference("RevitNodes")
import Revit
clr.ImportExtensions(Revit.Elements)

clr.AddReference("RevitServices")
import RevitServices
from RevitServices.Persistence import DocumentManager
from RevitServices.Transactions import TransactionManager


doc = DocumentManager.Instance.CurrentDBDocument

#getting all the views required
#lv = FilteredElementCollector(doc).OfClass(ViewPlan).WhereElementIsNotElementType().ToElements()

#xx = FilteredElementCollector(doc).OfClass(ViewSection).WhereElementIsNotElementType().ToElements()

yy = FilteredElementCollector(doc).OfClass(ViewSheet).WhereElementIsNotElementType().ToElements()


OUT = yy
# ----------------------------------------
get_revisions_on_sheet = Python(IN[0]=get_all_sheets)  # IronPython2
# ---------- get_revisions_on_sheet.python (28 lines) ----------
import clr

clr.AddReference('RevitAPI')
from Autodesk.Revit.DB import *
clr.AddReference("RevitNodes")
import Revit
clr.ImportExtensions(Revit.Elements)

clr.AddReference("RevitServices")
import RevitServices
from RevitServices.Persistence import DocumentManager
from RevitServices.Transactions import TransactionManager


doc = DocumentManager.Instance.CurrentDBDocument

yy = UnwrapElement(IN[0])
#yy = FilteredElementCollector(doc).OfClass(ViewSheet).WhereElementIsNotElementType().ToElements()

ff = []

for i in yy:
	ff.append(i.GetAllRevisionIds())
	
#elementid = []
#for i in ff: elementid.append(ElementId(i.Id))

OUT = ff
# ----------------------------------------
element_by_id = ElementById(Id=get_revisions_on_sheet)
revisionDate = Revision.RevisionDate(revision=element_by_id)
to_string_easily = Python(IN[0]=revisionDate)  # IronPython2
# ---------- to_string_easily.python (11 lines) ----------
#Copyright(c) 2015, Konrad K Sobon
# @arch_laboratory, http://archi-lab.net

import clr
clr.AddReference('ProtoGeometry')
from Autodesk.DesignScript.Geometry import *
#The inputs to this node will be stored as a list in the IN variable.
inp = IN[0]


OUT = map(str,inp)
# ----------------------------------------
flatten = List.Flatten(list=revisionDate)
sorted_by_date = Python(IN[0]=flatten)  # IronPython2
# ---------- sorted_by_date.python (12 lines) ----------
k = list(set(IN[0]))
y = []
for i in k:
	x = i[6:8]+i[3:5]+i[0:2]
	y.append(x)


c = zip(y, k)

f = sorted(c)
#strange way to get second element from every sublist
OUT = [element for _, element in f]
# ----------------------------------------
lastItem = List.LastItem(list=sorted_by_date)
contains = String.Contains(str=to_string_easily, searchFor=lastItem)
filterByBoolMask = List.FilterByBoolMask(list=get_all_sheets, mask=contains)
code_block = CodeBlock { "Appears In Sheet List"; }
parameterByName = Parameter.ParameterByName(element=get_all_sheets, name=code_block)
string_from_object = FromObject(obj=parameterByName)
if_no_rev_print_all = Python(IN[0]=get_all_sheets, IN[1]=filterByBoolMask.in, IN[2]=string_from_object)  # IronPython2
# ---------- if_no_rev_print_all.python (21 lines) ----------
aa = UnwrapElement(IN[0])
bb = UnwrapElement(IN[1])
cc = UnwrapElement(IN[2])

if bb == None:
	xx = []
	for i in range(len(aa)):
		if cc[i] == "Appears In Sheet List : Yes":
			xx.append(aa[i])
	#This script pops up a dialog box with a message from the previous node.
	
	import clr
	clr.AddReference('RevitAPIUI')
	from Autodesk.Revit.UI import TaskDialog
	messagePop = TaskDialog("Dynamo Player")
	messagePop.MainContent = "No revision found, print all sheets"
	messagePop.Show()
	
	OUT = xx
	
else: OUT = IN[1]
# ----------------------------------------
sorted = Python(IN[0]=if_no_rev_print_all)  # IronPython2
# ---------- sorted.python (16 lines) ----------
import clr
clr.AddReference('ProtoGeometry')
from Autodesk.DesignScript.Geometry import *
#The inputs to this node will be stored as a list in the IN variable.
inp = IN[0]
zz = []
for i in inp: zz.append(i.SheetNumber)

zipped = zip(zz,inp)

sorted_zipped_lists = sorted(zipped)

#crazy way to get the second element fom any sublist
sorted_list1 = [element for _, element in sorted_zipped_lists]

OUT = sorted_list1
# ----------------------------------------
watch = Watch(sorted)
current = Document.Current()
filePath = Document.FilePath(document=current)
folder = Python(IN[0]=filePath)  # IronPython2
# ---------- folder.python (7 lines) ----------
x = IN[0].split('\\')

f = x[len(x)-1:]

m = f[0].split(".")

OUT = m[0]
# ----------------------------------------
current_date = Python(IN[0]=folder)  # IronPython2
# ---------- current_date.python (3 lines) ----------
from datetime import date
today = date.today()
OUT = IN[0] + ' ' +today.strftime("%d.%m.%y")
# ----------------------------------------
folder_2 = Python(IN[0]=filePath)  # IronPython2
# ---------- folder_2.python (10 lines) ----------
x = IN[0].split('\\')

line = []
y = x[:-1]
z = []
for i in y: 
	z.append(i+'\\')
line = (''.join(z))

OUT = line+'Export'
# ----------------------------------------
watch_2 = Watch(folder_2)
pdf_print = Python(IN[0]=watch, IN[1]=current_date, IN[2]=watch_2)  # IronPython2
# ---------- pdf_print.python (38 lines) ----------
#Sean Page, 2021
import clr

clr.AddReference('RevitAPI')
from Autodesk.Revit.DB import *

clr.AddReference('System')
from System.Collections.Generic import List

clr.AddReference('RevitNodes')
import Revit
clr.ImportExtensions(Revit.Elements)

clr.AddReference('RevitServices')
import RevitServices
from RevitServices.Persistence import DocumentManager

doc = DocumentManager.Instance.CurrentDBDocument

Sheets = UnwrapElement(IN[0])
Names = IN[1]
Folder = IN[2]
result = []

opts = PDFExportOptions()
opts.Combine = True
opts.ColorDepth = ColorDepthType.Color
opts.ExportQuality = PDFExportQualityType.DPI600
opts.PaperFormat = ExportPaperFormat.Default #This will uses the Sheet Size for Paper size
opts.FileName = Names

sheetSet = List[ElementId]()
for i in Sheets:       
	sheetSet.Add(i.Id)

result.append(doc.Export(Folder,sheetSet,opts))

OUT = sheetSet
# ----------------------------------------
file_name = Python(IN[0]=folder_2, IN[1]=current_date)  # IronPython2
# ---------- file_name.python (1 lines) ----------
OUT = IN[0] + '\\' + IN[1] + ".pdf"
# ----------------------------------------
boolean = BoolSelector(true)
string = StringInput("C:\Program Files (x86)\Adobe\Acrobat DC\Acrobat\Acrobat.exe")
string_2 = StringInput("C:\Program Files\Bluebeam Software\Bluebeam Revu\Revu\Revu.exe")
file_open = Python(IN[0]=file_name, IN[1]=boolean, IN[2]=string, IN[3]=string_2)  # IronPython2
# ---------- file_open.python (32 lines) ----------
# Load the Python Standard and DesignScript Libraries
import sys
import clr
import os
import subprocess
#clr.AddReference('ProtoGeometry')
#from Autodesk.DesignScript.Geometry import *

# The inputs to this node will be stored as a list in the IN variables.
#dataEnteringNode = IN

# Place your code below this line


txt1 = IN[0]
#txt1 = 'C:\1.txt'
bool = IN[1]


#SPath = r'C:\Windows\System32\notepad.exe'


try:
	if bool:
		subprocess.Popen([IN[2], txt1])
except:
	if bool:
		subprocess.Popen([IN[3], txt1])

#subprocess.Popen('explorer "C:\temp"') #itWorks!
# Assign your output to the OUT variable.
#OUT = 0
# ----------------------------------------
